# Grasshopper definition irb2600_Calibration.ghx (Grasshopper 1.0.7)

info = Info()  # -> info
#   port info: Environment info.
# ---------- info: Python ----------
"""
Displays information about the active COMPAS environment.
"""
import compas_bootstrapper
from ghpythonlib.componentbase import executingcomponent as component

import compas
import compas_fab


class CompasInfo(component):
    def RunScript(self):
        self.Message = 'COMPAS v{}'.format(compas.__version__)
        info = 'COMPAS Version: {}\nEnvironment: {}\nCOMPAS FAB Version:{}'
        return (info.format(compas.__version__, compas_bootstrapper.ENVIRONMENT_NAME,compas_fab.__version__))
# ---------- end info ----------
number_slider = Slider(1000, range=0..1000)
# Dual ABB IRB2600 Calibration - 01112024
# Author: Jingwen Wang
# Email: jingwen.wang@epfl.ch
# Package Version: COMPAS Version: 1.17.5
# Environment: ar503
# COMPAS FAB Version:0.28.0
your_version = Panel(info)
number_slider_2 = Slider(1000, range=0..1000)
panel = Panel("""505.05
895.67
484.22
862.72
851.44
514.13
336.12
794.10""")
panel_2 = Panel("""226.25
229.26
564.62
567.42
566.32
564.71
225.57
227.61""")
panel_3 = Panel("""701.38
311.07
720.26
341.02
345.45
681.91
862.74
402.76""")
panel_4 = Panel("""227.52
226.33
567.13
564.90
564.96
566.63
229.26
225.33""")
panel_5 = Panel("""532.66
580.18
568.20
560.53
-323.51
-373.82
-402.81
-412.32""")
panel_6 = Panel("""-527.44
-578.51
-563.26
-559.50
323.37
376.82
407.69
413.40""")

pt = ConstructPoint(XCoordinate="413.07", YCoordinate="438.72", ZCoordinate="482.14")

pt_2 = ConstructPoint(XCoordinate="449.32", YCoordinate="299.87", ZCoordinate="78.74")

pt_3 = ConstructPoint(XCoordinate="348.62", YCoordinate="-389.41", ZCoordinate="532.88")

pt_4 = ConstructPoint(XCoordinate="401.08", YCoordinate="465.00", ZCoordinate="677.67")

pt_5 = ConstructPoint(XCoordinate="833.11", YCoordinate="325.86", ZCoordinate="47.09")

pt_6 = ConstructPoint(XCoordinate="382.62", YCoordinate="374.06", ZCoordinate="43.67")

pt_7 = ConstructPoint(XCoordinate="354.22", YCoordinate="-380.08", ZCoordinate="29.89")

pt_8 = ConstructPoint(XCoordinate="750.32", YCoordinate="-296.46", ZCoordinate="80.22")

pt_9 = ConstructPoint(XCoordinate="371.57", YCoordinate="-322.56", ZCoordinate="45.15")

pt_10 = ConstructPoint(XCoordinate="823.64", YCoordinate="-367.31", ZCoordinate="47.74")

pt_11 = ConstructPoint(XCoordinate="791.25", YCoordinate="-431.81", ZCoordinate="486.21")

pt_12 = ConstructPoint(XCoordinate="854.52", YCoordinate="391.10", ZCoordinate="534.74")

pt_13 = ConstructPoint(XCoordinate="756.45", YCoordinate="378.06", ZCoordinate="705.33")

pt_14 = ConstructPoint(XCoordinate="794.25", YCoordinate="-464.01", ZCoordinate="678.26")

pt_15 = ConstructPoint(XCoordinate="845.05", YCoordinate="386.68", ZCoordinate="33.73")

pt_16 = ConstructPoint(XCoordinate="438.35", YCoordinate="-373.31", ZCoordinate="703.97")

construct_point = ConstructPoint(XCoordinate=panel, YCoordinate=panel_5, ZCoordinate=panel_2)
construct_point_2 = ConstructPoint(XCoordinate=panel_3, YCoordinate=panel_6, ZCoordinate=panel_4)
division = Division(A=construct_point, B=number_slider)
division_2 = Division(A=construct_point_2, B=number_slider)
division_3 = Division(A=pt_2, B=number_slider_2)
division_4 = Division(A=pt_4, B=number_slider_2)
division_5 = Division(A=pt_8, B=number_slider)
division_6 = Division(A=pt_13, B=number_slider_2)
division_7 = Division(A=pt_6, B=number_slider)
division_8 = Division(A=pt_12, B=number_slider)
division_9 = Division(A=pt_10, B=number_slider_2)
division_10 = Division(A=pt_14, B=number_slider)
division_11 = Division(A=pt_5, B=number_slider)
division_12 = Division(A=pt_16, B=number_slider)
division_13 = Division(A=pt, B=number_slider)
division_14 = Division(A=pt_9, B=number_slider_2)
division_15 = Division(A=pt_7, B=number_slider)
division_16 = Division(A=pt_3, B=number_slider_2)
division_17 = Division(A=pt_15, B=number_slider_2)
division_18 = Division(A=pt_11, B=number_slider_2)
pt_17 = Point(division_3)
pt_18 = Point(division_7)
pt_19 = Point(division_13)
pt_20 = Point(division_4)
pt_21 = Point(division_15)
pt_22 = Point(division_11)
pt_23 = Point(division_8)
pt_24 = Point(division_5)
pt_25 = Point(division_6)
pt_26 = Point(division_12)
pt_27 = Point(division_10)
pt_28 = Point(division_16)
pt_29 = Point(division_17)
pt_30 = Point(division_18)
pt_31 = Point(division_9)
pt_32 = Point(division_14)
merge = Merge(Data1=pt_32, Data2=pt_31, Data3=pt_30, Data4=pt_28, Data5=pt_17, Data6=pt_29, Data7=pt_25, Data8=pt_20)
merge_2 = Merge(Data1=pt_22, Data2=pt_18, Data3=pt_19, Data4=pt_23, Data5=pt_24, Data6=pt_21, Data7=pt_26, Data8=pt_27)
# Remove the outlier points if necessary
panel_7 = Panel("""0
1
2
3
4
5""")  # disabled

# ----
# Transformation from b to a
ghpython_script = GhPythonScript(list_a=division_2, list_b=division)  # -> out, T, T_inv, T_R, T_Rinv, error_l, xyz, rpy; inputs list_a: list of Point3d, list_b: list of Point3d
# ---------- ghpython_script: Python ----------
"""Calibration"""

__author__ = "jwang"
__version__ = "2023.04.12"

import rhinoscriptsyntax as rs
import copy
import compas
from compas.geometry import Point, Frame, Transformation, Vector
from compas.geometry import matrix_from_frame_to_frame as ma
from compas_rhino.conversions import xform_to_rhino
import math
compas.PRECISION = '12f'

# combination calculation for point lists C5_2
def comb2(n):
    comb2= []
    for i in range(n-1):
        for j in range(i+1,n):
            comb2.append((i,j))
    return comb2
# combination calculation for point lists C5_3
def comb3(n):
    comb3= []
    for i in range(n-2):
        for (a,b) in comb2(n-i-1):
            comb3.append((i,a+i+1,b+i+1))
    return comb3

#quaternion matrix average calculation
def ave_Matrix(list_M):
    M_ave = copy.deepcopy(list_M[0])
    for i in range(4):
        for j in range(4):
            M_ave[i][j] = 0
    for M in list_M:
        for i in range(4):
            for j in range(4):
                M_ave[i][j] += 1/len(list_M) * M[i][j]
    T = Transformation.from_matrix(M_ave)
    return T


if len(list_a) != len(list_b):
    print("Error, length not equal")
else:
    list_M = []
    error_l = []
    for i,j,k in comb3(len(list_a)):
        #print(i,j,k)
        F_A = Frame.from_points(list_a[i],list_a[j],list_a[k])
        F_B = Frame.from_points(list_b[i],list_b[j],list_b[k])
        T_bta = ma(F_B,F_A)
        #print(T_bta)
        list_M.append(T_bta)
    T = ave_Matrix(list_M)
    print("________Average__________")
    print(T)
    T_R = xform_to_rhino(T)
    T_inv = T.inverse()
    T_Rinv = xform_to_rhino(T_inv)
    Scale, Shear, Rotation, Translation, Projection = T.decomposed()
    rpy = Rotation.euler_angles(static=True, axes ='xyz')
    xyz = Translation.translation_vector[0],Translation.translation_vector[1],Translation.translation_vector[2]
    T_update = Translation.from_vector(Vector(*xyz)) * Rotation.from_euler_angles(rpy,static = True, axes = "xyz")
    print(T_update)
# Calculation for the calibration error
    for pa,pb in zip(list_a, list_b):
        pa_c = Point(pa.X, pa.Y, pa.Z)
        pb_c = Point(pb.X, pb.Y, pb.Z)
        pb_t = pb_c.transformed(T_update)
        error = pow((pb_t[0]-pa_c[0]),2)+pow((pb_t[1]-pa_c[1]),2)+pow((pb_t[2]-pa_c[2]),2)
        error_l.append(pow(error,0.5))
# ---------- end ghpython_script ----------
number_slider_3 = Slider(0.01, range=0..0.1)
transform = Transform(Geometry=division, Transform=ghpython_script.T_R)
error = Panel(ghpython_script.error_l)
dot_display = DotDisplay(Point=division_2, Colour=ColourSwatch(SwatchColor=RGBA(0, 255, 0, 148)), Size=number_slider_3)
dot_display_2 = DotDisplay(Point=transform, Colour=ColourSwatch(SwatchColor=RGBA(255, 0, 0, 143)), Size=number_slider_3)
point_list = PointList(Points=division_2, Size=Slider(0.05, range=0..0.1))

# ----
# T* relative to B = relative to A
# T_inv * relative to A = relative to B
list_item = ListItem(List=division_2, Index=panel_7, Wrap=True)  # disabled
list_item_2 = ListItem(List=division, Index=panel_7, Wrap=True)  # disabled
ghpython_script_2 = GhPythonScript(list_a=list_item, list_b=list_item_2)  # -> out, T, T_inv, T_R, T_Rinv, error_l, xyz, rpy; inputs list_a: list of Point3d, list_b: list of Point3d; disabled; same code as ghpython_script
mass_addition = MassAddition(Input=ghpython_script.error_l)  # -> Result, PartialResults
rpy = Panel(ghpython_script_2.rpy)  # disabled
xyz = Panel(ghpython_script_2.xyz)  # disabled
error_2 = Panel(ghpython_script_2.error_l)  # disabled
multiplication = Multiplication(A=mass_addition.Result, B=1000)
panel_8 = Panel(multiplication)
panel_9 = Panel(ghpython_script.xyz)
panel_10 = Panel(ghpython_script.rpy)

# ---- group: From VisualStudio Scipy Optimizer
panel_11 = Panel("""1204.34792
8.55868803
6.36037738""")
panel_12 = Panel("""-0.00100184180
0.00949131399
-3.13337030""")

# ----
connect = BooleanToggle(True)
division_19 = Division(A=panel_11, B=1000)
# Robot Test
ros_connect = ROSConnect(connect=connect)  # -> ros_client, is_connected; inputs port: Int32, connect: Boolean
#   port ip: The ip address ROS. Defaults to 127.0.0.1.
#   port port: The port of ROS. Defaults to 9090.
#   port connect: If True, connects to ROS. If False, disconnects from ROS. Defaults to False.
#   port ros_client: The ROS client.
#   port is_connected: True if connection established.
# ---------- ros_connect: Python ----------
"""
Connect or disconnect to ROS.

COMPAS FAB v0.27.0
"""
from ghpythonlib.componentbase import executingcomponent as component
from scriptcontext import sticky as st

from compas_fab.backends import RosClient
from compas_fab.ghpython.components import create_id


class ROSConnect(component):
    def RunScript(self, ip, port, connect):
        ros_client = None

        ip = ip or '127.0.0.1'
        port = port or 9090

        key = create_id(self, 'ros_client')
        ros_client = st.get(key, None)

        if ros_client:
            st[key].close()
        if connect:
            st[key] = RosClient(ip, port)
            st[key].run(5)

        ros_client = st.get(key, None)
        is_connected = ros_client.is_connected if ros_client else False
        return (ros_client, is_connected)
# ---------- end ros_connect ----------
ghpython_script_3 = GhPythonScript(xyz=simplify(flatten(division_19)), rpy=simplify(flatten(panel_12)))  # -> out, T, T_R, T_inv, T_Rinv; inputs xyz: list, rpy: list
# ---------- ghpython_script_3: Python ----------
from compas.geometry import Translation, Rotation, Vector
from compas_rhino.conversions import xform_to_rhino 
T= Translation.from_vector(Vector(*xyz)) * Rotation.from_euler_angles(rpy,static = True, axes = "xyz")
T_R = xform_to_rhino(T)
T_inv = T.inverse()
T_Rinv = xform_to_rhino(T_inv)
# ---------- end ghpython_script_3 ----------
point = Point(Point(-0.5494549552, -0.2417068311, 0.363781943))
point_2 = Point(Point(1, 1.5, 0))
point_3 = Point(Point(0, 0, 1))
point_4 = Point(Point(1, 0, 0))
construct_plane = ConstructPlane(Origin=point, XAxis=point_2, YAxis=point_3)
radians = Radians(Degrees=Slider(50, range=-60..100))
ros_robot = ROSRobot(ros_client=ros_connect.ros_client, load=Toggle(True))  # -> robot; inputs load: Boolean
#   port ros_client: The ROS client.
#   port load: If True, loads the robot from ROS. Defaults to False.
# ---------- ros_robot: Python ----------
"""
Load robot directly from ROS.

COMPAS FAB v0.24.0
"""
from compas_ghpython.artists import RobotModelArtist
from ghpythonlib.componentbase import executingcomponent as component
from scriptcontext import sticky as st

from compas_fab.ghpython.components import create_id


class ROSRobot(component):
    def RunScript(self, ros_client, load):
        key = create_id(self, 'robot')

        if ros_client and ros_client.is_connected and load:
            # Load URDF from ROS
            st[key] = ros_client.load_robot(load_geometry=True, precision='12f')
            st[key].artist = RobotModelArtist(st[key].model)

        robot = st.get(key, None)
        if robot:  # client sometimes need to be restarted, without needing to reload geometry
            robot.client = ros_client
        return robot
# ---------- end ros_robot ----------
rotate_3d = Rotate3D(Geometry=construct_plane, Angle=radians, Center=point, Axis=point_2)  # -> Geometry, Transform
boolean_toggle = BooleanToggle(True)
# Get Frame & Send Frame
distance = Slider(43, range=0..100)
plane = Plane(rotate_3d.Geometry)
inverse_kinematics = InverseKinematics(robot=ros_robot, plane=construct_plane)  # -> configuration
#   port plane: The plane or frame to calculate the inverse kinematic for.
#   port start_configuration: If passed, calculates the inverse such that the joint positions differ the least from the start_configuration. Defaults to the zero configuration.
#   port group: The planning group used for calculation. Defaults to the robot's main planning group.
#   port configuration: The planning group's configuration.
# ---------- inverse_kinematics: Python ----------
"""
Calculate the robot's inverse kinematic for a given plane.

COMPAS FAB v0.24.0
"""
from ghpythonlib.componentbase import executingcomponent as component

from compas_fab.ghpython.components import coerce_frame


class InverseKinematics(component):
    def RunScript(self, robot, plane, start_configuration, group):
        configuration = None
        if robot and robot.client and robot.client.is_connected and plane:
            frame = coerce_frame(plane)
            configuration = robot.inverse_kinematics(frame, start_configuration, group)
        return configuration
# ---------- end inverse_kinematics ----------

# ----
# Get Frame & Send Frame
number_slider_4 = Slider(50, range=0..300)
ros_client = Data(ros_connect.ros_client)
python = GhPythonScript(ros=ros_client, run=Button(), plane=rotate_3d.Geometry, x=distance, speed=number_slider_4)  # inputs plane: Plane
# ---------- python: Python ----------
import compas_rrc as rrc
from compas.geometry import Frame, Translation
from compas_rhino.conversions import plane_to_compas_frame as ptf   
abb = rrc.AbbClient(ros, '/rob1')
print('Connected.')

frame = ptf(plane)
frame = Frame([frame[0][0]*1000,frame[0][1]*1000,frame[0][2]*1000],frame[1],frame[2])
print(frame)
if run : 
#    frame = abb.send_and_wait(rrc.GetFrame())
#    T = Translation.from_vector([50,0,0])
#    frame = frame.transformed(T)
    done = abb.send_and_wait(rrc.SetTool("pintool"))
    print(done)
    done = abb.send_and_wait(rrc.PrintText("Update Tool"))
    T = Translation.from_vector([0,x,0])
    frame = frame.transformed(T)
    abb.send_and_wait(rrc.MoveToFrame(frame, speed, rrc.Zone.FINE, rrc.Motion.JOINT))
# ---------- end python ----------

flip_plane = FlipPlane(Plane=plane, ReverseX=boolean_toggle, ReverseY=boolean_toggle, SwapAxes=True)
ros_client_2 = Data(ros_connect.ros_client)
transform_2 = Transform(Geometry=flip_plane, Transform=ghpython_script_3.T_Rinv)
transform_3 = Transform(Geometry=flip_plane, Transform=ghpython_script.T_Rinv)
python_2 = GhPythonScript(ros=ros_client_2, run=Button(), plane=transform_2, x=distance, speed=Slider(24, range=0..300))  # inputs run: Boolean, plane: Plane, speed: Int32
# ---------- python_2: Python ----------
import compas_rrc as rrc
from compas.geometry import Frame, Translation
from compas_rhino.conversions import plane_to_compas_frame as ptf   
abb = rrc.AbbClient(ros, '/rob1')
print('Connected.')

frame = ptf(plane)
frame = Frame([frame[0][0]*1000,frame[0][1]*1000,frame[0][2]*1000],frame[1],frame[2])
print(frame)
if run : 
#    frame = abb.send_and_wait(rrc.GetFrame())
#    T = Translation.from_vector([50,0,0])
#    frame = frame.transformed(T)
    done = abb.send(rrc.SetTool("pintool"))
    print(done)
    done = abb.send(rrc.PrintText("Update Tool"))
    T = Translation.from_vector([0,x,0])
    frame = frame.transformed(T)
    abb.send_and_wait(rrc.MoveToFrame(frame, speed, rrc.Zone.FINE, rrc.Motion.JOINT))
# ---------- end python_2 ----------
robot_visualize = RobotVisualize(robot=ros_robot, configuration=inverse_kinematics)  # -> visual, collision, attached_meshes, frames, base_frame, ee_frame; inputs attached_collision_meshes: list, show_visual: Boolean, show_collision: Boolean, show_frames: Boolean, show_base_frame: Boolean, show_end_effector_frame: Boolean, show_acm: Boolean
#   port group: The planning group used for end-effector and base visualization.
#   port configuration: The robot's full configuration.
#   port attached_collision_meshes: A list of attached collision meshes.
#   port show_visual: Whether or not to show the robot's visual meshes.
#   port show_collision: Whether or not to show the robot's collision meshes.
#   port show_frames: Whether or not to show the robot's joint frames.
#   port show_base_frame: Whether or not to show the robot's base frame.
#   port show_end_effector_frame: Whether or not to show the robot's end-effector frame.
#   port show_acm: Whether or not to show the attached collision meshes (if any).
#   port visual: The robot's visual Rhino meshes (if any).
#   port collision: The robot's collision Rhino meshes (if any).
#   port attached_meshes: The attached collision Rhino meshes (if any).
#   port frames: The robot's joint frames as Rhino planes (if any).
#   port base_frame: The robot's base frame as a Rhino plane (if any).
#   port ee_frame: The robot's end-effector frame as a Rhino plane (if any).
# ---------- robot_visualize: Python ----------
"""
Visualizes the robot.

COMPAS FAB v0.24.0
"""
from compas.geometry import Frame
from compas.geometry import Transformation
from compas_ghpython.artists import FrameArtist
from compas_ghpython.artists import MeshArtist
from ghpythonlib.componentbase import executingcomponent as component


class RobotVisualize(component):
    def RunScript(self, robot, group, configuration, attached_collision_meshes, show_visual, show_collision,
                  show_frames, show_base_frame, show_end_effector_frame, show_acm):

        visual = None
        collision = None
        attached_meshes = None
        frames = None
        base_frame = None
        ee_frame = None

        if robot:
            show_visual = True if show_visual is None else show_visual
            configuration = configuration or robot.zero_configuration()

            robot.update(configuration, visual=show_visual, collision=show_collision)
            compas_frames = robot.transformed_frames(configuration, group)

            if show_visual:
                visual = robot.artist.draw_visual()

            if show_collision:
                collision = robot.artist.draw_collision()

            if show_base_frame:
                base_compas_frame = compas_frames[0]
                artist = FrameArtist(base_compas_frame)
                base_frame = artist.draw()

            if show_end_effector_frame:
                ee_compas_frame = robot.forward_kinematics(configuration, group, options=dict(solver='model'))
                artist = FrameArtist(ee_compas_frame)
                ee_frame = artist.draw()

            if show_frames:
                frames = []
                for compas_frame in compas_frames[1:]:
                    artist = FrameArtist(compas_frame)
                    frame = artist.draw()
                    frames.append(frame)

            if show_acm:
                attached_meshes = []
                for acm in attached_collision_meshes:
                    frame = robot.forward_kinematics(configuration, options=dict(solver='model', link_name=acm.link_name))
                    T = Transformation.from_frame_to_frame(Frame.worldXY(), frame)
                    mesh = acm.collision_mesh.mesh.transformed(T)
                    attached_meshes.append(MeshArtist(mesh).draw())

        return (visual, collision, attached_meshes, frames, base_frame, ee_frame)
# ---------- end robot_visualize ----------
panel_13 = Panel("A")
panel_14 = Panel("B")
point_5 = Point(transform_2)
point_6 = Point(transform_3)
subtraction = Subtraction(A=point_6, B=point_5)
panel_15 = Panel(subtraction)
